# Grasshopper definition sortUnits.gh (Grasshopper 1.0.7)

mesh = Mesh([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])
volume = Volume(Geometry=mesh)  # -> Volume, Centroid

panel = Panel("0.01")  # disabled
sort_points = GhPythonScript(points=volume.Centroid, precision=panel)  # -> out, pts_sorted; inputs points: list of Point3d; disabled
# ---------- sort_points: Python ----------
__author__ = "Wenqian"
__version__ = "2021.12.05"

import rhinoscriptsyntax as rs
import Rhino.Geometry as rg


def sortZ(pts, precision):
    
    Z = []
    Z.append([])

    pts = sorted(pts, key=lambda x: x.Z)
    z_divide = pts[0].Z
    i = 0
    
    for pt in pts:
        if pt.Z - z_divide < precision:
            Z[i].append(pt)
        else:
            z_divide = pt.Z
            Z.append([])
            i += 1
            Z[i].append(pt)
    
    return Z

def sortY(pts, precision):
    
    Y = []
    Y.append([])

    pts = sorted(pts, key=lambda x: x.Y)
    y_divide = pts[0].Y
    i = 0
    
    for pt in pts:
        if pt.Y - y_divide < precision:
            Y[i].append(pt)
        else:
            y_divide = pt.Y
            Y.append([])
            i += 1
            Y[i].append(pt)
    
    return Y

def sortX(pts, precision):
    
    X = []
    X.append([])

    pts = sorted(pts, key=lambda x: x.X)
    x_divide = pts[0].X
    i = 0
    
    for pt in pts:
        if pt.X - x_divide < precision:
            X[i].append(pt)
        else:
            x_divide = pt.X
            X.append([])
            i += 1
            X[i].append(pt)
    
    return X

pts_sorted = []

Z_list = sortZ(points, precision)

for Z in Z_list:
    Y_list = sortY(Z, precision)
    for Y in Y_list:
        X_list = sortX(Y, precision)
        for X in X_list:
            pts_sorted.extend(X)

print(len(pts_sorted))
# ---------- end sort_points ----------

panel_2 = Panel("C:\Users\Wenqian\Desktop\20211203_T2\20211214_input_model\objtest\test.obj")
pdecon = Deconstruct(Point=volume.Centroid)  # -> XComponent, YComponent, ZComponent
panel_3 = Panel("""mtllib violetblue.mtl
usemtl violetblue""")
panel_4 = Panel("""mtllib cossackgreen.mtl
usemtl cossackgreen""")
panel_5 = Panel("""mtllib glaucousgreen.mtl
usemtl glaucousgreen""")
panel_6 = Panel("""mtllib vinaceoustawny.mtl
usemtl vinaceoustawny""")
panel_7 = Panel("""mtllib seashellpink.mtl
usemtl seashellpink""")
panel_8 = Panel("""mtllib palelemonyellow.mtl
usemtl palelemonyellow""")
multiplication = Multiplication(A=pdecon.ZComponent, B=1000000)
multiplication_2 = Multiplication(A=pdecon.YComponent, B=1000)
merge = Merge(Data1=panel_3, Data2=panel_4, Data3=panel_5, Data4=panel_6, Data5=panel_7, Data6=panel_8)
addition = Addition(A=pdecon.XComponent, B=multiplication_2, C=multiplication)
path = FilePath(panel_2)
sort = SortList(Keys=addition, ValuesA=mesh)  # -> Keys, ValuesA
mesh_2 = Mesh(sort.ValuesA)
lng = ListLength(List=mesh_2)
series = Series(Start=Slider(1, range=0..1), Step=1, Count=lng)
panel_9 = Panel(lng)
c_script = CSharpScript(in_run=Button(), in_mesh=graft(mesh_2), in_name=graft(series), mtl=merge, in_path=path)  # -> out, A, B; inputs in_run: Boolean, in_mesh: list of Mesh, in_name: String, mtl: list of String, in_path: String
# ---------- c_script: C# usings ----------
using System.IO;
using System.Linq;
using System.Data;
using System.Drawing;
using System.Reflection;
using System.Windows.Forms;
using System.Xml;
using System.Xml.Linq;
using System.Runtime.InteropServices;

using Rhino.DocObjects;
using Rhino.Collections;
using GH_IO;
using GH_IO.Serialization;
# ---------- c_script: C# ----------
    //var rand = new Random();
    len = mtl.Count;
    
    if(in_run) {
      path = System.IO.Path.GetDirectoryName(in_path) + "\\" + in_name + ".obj";
      
      mat_index = rand.Next(len);
      
      int faceCount = 0;
      using(StreamWriter writer = new StreamWriter(path)) {
        
        writer.Write(mtl[mat_index]);
        
        for(int n = 0; n < in_mesh.Count; n++) {
          List<String> vert = new List<String>();
          List<String> face = new List<String>();

          in_mesh[n].Faces.ConvertQuadsToTriangles();
          BoundingBox bbox = in_mesh[n].GetBoundingBox(true);

          for(int i = 0; i < in_mesh[n].Vertices.Count; i++) {
            vert.Add(String.Format("v {0} {1} {2}", -in_mesh[n].Vertices[i].X, in_mesh[n].Vertices[i].Z, in_mesh[n].Vertices[i].Y));
          }

          for(int i = 0; i < in_mesh[n].TextureCoordinates.Count; i++) {
            double tx = in_mesh[n].TextureCoordinates[i].X;
            double ty = in_mesh[n].TextureCoordinates[i].Y;
            vert.Add(String.Format("vt " + tx.ToString("F6") + " " + ty.ToString("F6")));
          }

          for(int i = 0; i < in_mesh[n].Normals.Count; i++) {
            vert.Add(String.Format("vn {0} {1} {2}", -in_mesh[n].Normals[i].X, in_mesh[n].Normals[i].Z, in_mesh[n].Normals[i].Y));
          }

          for(int i = 0; i < in_mesh[n].Faces.Count; i++) {
            MeshFace f = in_mesh[n].Faces.GetFace(i);
            int fa = f.A + 1 + faceCount;
            int fb = f.B + 1 + faceCount;
            int fc = f.C + 1 + faceCount;
            string fas = fa.ToString();
            string fbs = fb.ToString();
            string fcs = fc.ToString();
            face.Add(String.Format("f " + fas + "/" + fas + "/" + fas + " " + fbs + "/" + fbs + "/" + fbs + " " + fcs + "/" + fcs + "/" + fcs));
          }

          for(int i = 0; i < vert.Count; i++) {
            writer.WriteLine(vert[i]);
          }

          writer.WriteLine("");
          writer.WriteLine("g " + in_name + n.ToString());

          for(int i = 0; i < face.Count; i++) {
            writer.WriteLine(face[i]);
          }
          faceCount += in_mesh[n].Vertices.Count;
        }
      }
    }
    A = path;
    B = in_mesh.Count;
# ---------- c_script: C# additional code ----------
  String path;
  private int mat_index;
  private int len;
  private Random rand = new Random();
# ---------- end c_script ----------
item = ListItem(List=sort.ValuesA, Index=Slider(50, range=0..71), Wrap=True)
